# Grasshopper definition 4D transformation.gh (Grasshopper 1.0.7)

mesh = Mesh(<mesh referenced from the Rhino model>)
bbox = BoundingBox(Content=mesh, Plane=PlaneXY(0, 0, 0))  # -> Box, Box_2
debrep = DeconstructBrep(Brep=bbox.Box)  # -> Faces, Edges, Vertices
item = ListItem(List=debrep.Faces, Index=Slider(4, range=0..100), Wrap=True)
len = Length(Curve=debrep.Edges)
sort = SortList(Keys=len)  # -> reverse(Keys), ValuesA
area = Area(Geometry=item)  # -> Area, Centroid
item_2 = ListItem(List=sort.Keys, Index=0, Wrap=True)
division = Division(A="20", B=item_2)

item_3 = ListItem(List=debrep.Edges, Index=Slider(8, range=0..10), Wrap=True)
len_2 = Length(Curve=item_3)
# Scale and Position
expression = Expression(x=len_2, Expression="-x/2")

pt = ConstructPoint(XCoordinate=0, YCoordinate=0, ZCoordinate=expression)
vec2pt = Vector2Pt(PointA=area.Centroid, PointB=pt, Unitize=False)  # -> Vector, Length
move = Move(Geometry=mesh, Motion=vec2pt.Vector)  # -> Geometry, Transform
scale = Scale(Geometry=move.Geometry, Center=Point(0, 0, 0), Factor=division)  # -> Geometry, Transform

# ----
# Remesh
qrsettings = QuadRemeshSettings(
    TargetCount=Slider(500, range=0..10000),
    AdaptiveSize=0,
    AdaptiveCount="true",
    HardEdges=False,
    SeamEdges=0,
    Symmetry=0,
    GuideCurves=0)
qrmesh = QuadRemesh(Mesh=scale.Geometry, Settings=qrsettings)
demesh = DeconstructMesh(Mesh=qrmesh)  # -> Vertices, Faces, Colours, Normals

rad = Radians(Degrees=Slider(20, range=0..360))
rad_2 = Radians(Degrees=Slider(0, range=0..360))
rad_3 = Radians(Degrees=Slider(0, range=0..360))
rad_4 = Radians(Degrees=Slider(0, range=0..360))
rad_5 = Radians(Degrees=Slider(0, range=0..360))
# 4D Transform
rad_6 = Radians(Degrees=Slider(0, range=0..360))
c_script = CSharpScript(
    pts_3d=demesh.Vertices,
    w_range="-10 to 10",
    w_count=Slider(100, range=0..100),
    angle_xw=rad,
    angle_yw=rad,
    angle_zw=rad,
    angle_xy=rad,
    angle_xz=rad,
    angle_yz=rad)  # -> out, Pts_3d_w0, Pts_3d_wext, W_ext, Pts_new; inputs pts_3d: list of Point3d, w_count: Int32, angle_xw: Double, angle_yw: Double, angle_zw: Double, angle_xy: Double, angle_xz: Double, angle_yz: Double
# ---------- c_script: C# ----------
    // define variables
    List<Point3d> pts_3d_w0 = new List<Point3d>();
    List<Point3d> pts_3d_wext = new List<Point3d>();
    List<Point4d> pts_4d = new List<Point4d>();
    List<Point4d> pts_4d_rot = new List<Point4d>();
    List<double> pts_4d_rw = new List<double>();
    List<double> w_divide = new List<double>();
    List<double> w_ext = new List<double>();
    List<Point3d> pts_3d_new = new List<Point3d>();
    double dist = w_range.Length / (w_count - 1);
    // get the divided points between the w range
    w_divide = int_divide(w_range, w_count);

    //transform the existing 3d points into 4d points and extrude in the w dimension
    for( int i = 0;i < pts_3d.Count;i++)
    {
      double x_w0 = pts_3d[i].X;
      double y_w0 = pts_3d[i].Y;
      double z_w0 = pts_3d[i].Z;
      for (int j = 0; j < w_divide.Count;j++)
      {
        double w_j = w_divide[j];
        Point4d pt_4d = new Point4d(x_w0, y_w0, z_w0, w_j);
        pts_4d.Add(pt_4d);
      }
    }

    // rotation the 4d points
    for(int i = 0; i < pts_4d.Count;i++)
    {
      Matrix m_xy ;
      Matrix m_xz ;
      Matrix m_yz ;
      Matrix m_xw ;
      Matrix m_yw ;
      Matrix m_zw ;
      m_xy = rotate_xy(pts_4d[i], angle_xy);
      Point4d rot_xy = matrix_to_4d(m_xy);

      m_xz = rotate_xz(rot_xy, angle_xz);
      Point4d rot_xz = matrix_to_4d(m_xz);

      m_yz = rotate_yz(rot_xz, angle_yz);
      Point4d rot_yz = matrix_to_4d(m_yz);

      m_xw = rotate_xw(rot_yz, angle_xw);
      Point4d rot_xw = matrix_to_4d(m_xw);

      m_yw = rotate_xw(rot_xw, angle_yw);
      Point4d rot_yw = matrix_to_4d(m_yw);

      m_zw = rotate_zw(rot_yw, angle_zw);
      Point4d rot_zw = matrix_to_4d(m_zw);





      pts_4d_rot.Add(rot_zw);


      //filter the 4d points at w0 hyper plane
      if(rot_zw.W > (-dist / 2  ) && rot_zw.W < (dist / 2) )
      {
        pts_4d_rw.Add(pts_4d[i].W);
        Point3d pt_new = new Point3d(rot_zw.X, rot_zw.Y, rot_zw.Z);
        pts_3d_new.Add(pt_new);
        if(pts_4d[i].W > (-dist / 2) && pts_4d[i].W < (dist / 2))
        {
          Point3d pt_w0 = new Point3d(rot_zw.X, rot_zw.Y, rot_zw.Z);
          pts_3d_w0.Add(pt_w0);
        }
        else
        {
          Point3d pt_wext = new Point3d(rot_zw.X, rot_zw.Y, rot_zw.Z);
          pts_3d_wext.Add(pt_wext);
          w_ext.Add(pts_4d[i].W);
        }

      }
    }

    Pts_3d_w0 = pts_3d_w0;
    Pts_3d_wext = pts_3d_wext;
    Pts_new = pts_3d_new;
    W_ext = w_ext;
# ---------- c_script: C# additional code ----------
  // create a 4d point class
  public class Point4d
  {
    public double X;
    public double Y;
    public double Z;
    public double W;

    public Point4d(double x, double y, double z, double w)
    {
      this.X = x;
      this.Y = y;
      this.Z = z;
      this.W = w;
    }

    public Matrix to_matrix()
    {
      Matrix m = new Matrix(4, 1);
      m[0, 0] = this.X;
      m[1, 0] = this.Y;
      m[2, 0] = this.Z;
      m[3, 0] = this.W;
      return m;
    }
  }
  // convert a 1X4 matrix to point4d
  public Point4d matrix_to_4d(Matrix m)
  {
    double x = m[0, 0];
    double y = m[1, 0];
    double z = m[2, 0];
    double w = m[3, 0];
    Point4d pt = new Point4d(x, y, z, w);
    return pt;
  }

  // rotation functions in xw,yw,zw
  public Matrix rotate_xw(Point4d pt, double angle)
  {
    Matrix n = new Matrix(4, 4);
    double[,] m = {{Math.Cos(angle),0,0,-Math.Sin(angle)},{0,1,0,0},{0,0,1,0},
      {Math.Sin(angle),0,0,Math.Cos(angle)}};
    for (int i = 0;i < 4;i++){
      for (int j = 0;j < 4;j++)
      {
        n[i, j] = m[i, j];
      }
    }
    Matrix n2 = pt.to_matrix();
    Matrix rotated = n * n2;

    return rotated;
  }

  public Matrix rotate_yw(Point4d pt, double angle)
  {
    Matrix n = new Matrix(4, 4);
    double[,] m = {{1,0,0,0},{0,Math.Cos(angle),0,-Math.Sin(angle)},{0,0,1,0},
      {0,Math.Sin(angle),0,Math.Cos(angle)}};
    for (int i = 0;i < 4;i++){
      for (int j = 0;j < 4;j++)
      {
        n[i, j] = m[i, j];
      }
    }
    Matrix n2 = pt.to_matrix();
    Matrix rotated = n * n2;

    return rotated;
  }

  public Matrix rotate_zw(Point4d pt, double angle)
  {
    Matrix n = new Matrix(4, 4);
    double[,] m = {{1,0,0,0},{0,1,0,0},{0,0,Math.Cos(angle),-Math.Sin(angle)},
      {0,0,Math.Sin(angle),Math.Cos(angle)}};
    for (int i = 0;i < 4;i++){
      for (int j = 0;j < 4;j++)
      {
        n[i, j] = m[i, j];
      }
    }
    Matrix n2 = pt.to_matrix();
    Matrix rotated = n * n2;

    return rotated;
  }

  public Matrix rotate_xy(Point4d pt, double angle)
  {
    Matrix n = new Matrix(4, 4);
    double[,] m = {{Math.Cos(angle),-Math.Sin(angle),0,0},{Math.Sin(angle),Math.Cos(angle),0,0},{0,0,1,0},
      {0,0,0,1}};
    for (int i = 0;i < 4;i++){
      for (int j = 0;j < 4;j++)
      {
        n[i, j] = m[i, j];
      }
    }
    Matrix n2 = pt.to_matrix();
    Matrix rotated = n * n2;

    return rotated;
  }

  public Matrix rotate_xz(Point4d pt, double angle)
  {
    Matrix n = new Matrix(4, 4);
    double[,] m = {{Math.Cos(angle),0,Math.Sin(angle),0},{0,1,0,0},{-Math.Sin(angle),0,Math.Cos(angle),0},
      {0,0,0,1}};
    for (int i = 0;i < 4;i++){
      for (int j = 0;j < 4;j++)
      {
        n[i, j] = m[i, j];
      }
    }
    Matrix n2 = pt.to_matrix();
    Matrix rotated = n * n2;

    return rotated;
  }

  public Matrix rotate_yz(Point4d pt, double angle)
  {
    Matrix n = new Matrix(4, 4);
    double[,] m = {{1,0,0,0},{0,Math.Cos(angle),-Math.Sin(angle),0},{0,Math.Sin(angle),Math.Cos(angle),0},
      {0,0,0,1}};
    for (int i = 0;i < 4;i++){
      for (int j = 0;j < 4;j++)
      {
        n[i, j] = m[i, j];
      }
    }
    Matrix n2 = pt.to_matrix();
    Matrix rotated = n * n2;

    return rotated;
  }


  // function to divide an interval into given count of numbers
  public List<double> int_divide(Interval interval, int n)
  {
    List<double> nums = new List<double>();
    double d = interval.Length / (n - 1);
    for(int i = 0;i < n;i++){
      double num = interval.Min + i * d;
      nums.Add(num);
    }
    return nums;
  }
# ---------- end c_script ----------

panel = Panel(c_script.Pts_3d_wext)
panel_2 = Panel(c_script.Pts_3d_w0)
panel_3 = Panel(c_script.W_ext)
panel_4 = Panel(c_script.Pts_new)

gradient = Gradient(
    LowerLimit=-10,
    UpperLimit=10,
    Parameter=c_script.W_ext,
    stops=[0.0784: RGB(220, 0, 40), 0.319: RGB(255, 130, 160), 0.752: RGB(0, 255, 255), 0.992: RGB(89, 39, 227)])
# Color
number_slider = Slider(0.02, range=0..0.1)
dots = DotDisplay(Point=c_script.Pts_3d_wext, Colour=gradient, Size=number_slider)
dots_2 = DotDisplay(Point=c_script.Pts_3d_w0, Colour="white", Size=number_slider)
