# Grasshopper definition iteration4_waterbomb.gh (Grasshopper 1.0.7)

# Module Width
number_slider = Slider(1.5, range=0..10)
# Cosine Scalar
# Input Cuts
crv = Curve(<curve referenced from the Rhino model>)
# Boundary
crv_2 = Curve(<curve referenced from the Rhino model>)
rad = Radians(Degrees=Slider(35, range=0..90))
cos = Cosine(Value=rad)

explode = Explode(Curve=crv_2, Recursive=True)  # -> Segments, Vertices
item = ListItem(List=explode.Segments, Index=Slider(3, range=0..100), Wrap=True)
item_2 = ListItem(List=explode.Segments, Index=Slider(2, range=0..100), Wrap=True)
c_script = CSharpScript(LineL=item_2, LineS=item, dx=number_slider, a=cos)  # -> out, Pts, TriMesh, Xcount, Ycount; inputs LineL: Line, LineS: Line, dx: Double, a: Double
# ---------- c_script: C# ----------
    Point3d pt0 = LineL.PointAt(1);
    int x_count = Convert.ToInt32((LineL.Length - LineL.Length % dx) / dx);
    double dy = Math.Tan(Math.Acos(a)) * dx ;
    int y_count = Convert.ToInt32((LineS.Length - LineS.Length % dy) / dy);

    // create triangular grid
    List<Point3d> pts = Tri_grid(x_count, y_count, pt0, dx, dy);

    // create mesh from the points
    Mesh mesh = Tri_mesh(x_count, y_count, pts);





    Pts = pts;
    TriMesh = mesh;
    Xcount = x_count;
    Ycount = y_count;
# ---------- c_script: C# additional code ----------
  // created triangular grid
  List<Point3d> Tri_grid (int x_count, int y_count, Point3d pt0, double dx, double dy)
  {
    List<Point3d> pts = new List<Point3d> ();
    int i,j;
    for( j = 0;j < y_count + 1;j++)
    {
      for(i = 0;i < x_count + 1;i++)
      {
        pts.Add(new Point3d(pt0.X + dx * i, pt0.Y - dy * j, 0));
      }
    }
    return pts;
  }

  Mesh Tri_mesh (int x_count, int y_count, List<Point3d>pts)
  {
    Mesh mesh = new Mesh();
    for(int i = 0; i < pts.Count;i++)
    {
      mesh.Vertices.Add(pts[i]);
    }
    for( int j = 0;j < y_count + 1;j++)
    {
      for(int i = 0;i < x_count + 1;i++)
      {
        int k = i + (1 + x_count) * j;
        int l = i + (1 + x_count) * (j + 1);
        int m = i + (1 + x_count) * (j + 2);
        if(j % 4 == 0 && j + 1 != y_count && j != y_count)
        {
          if(i % 2 == 0 && i != x_count)
          {
            mesh.Faces.AddFace(k, k + 1, l + 1);
            mesh.Faces.AddFace(k, m, l + 1);
            mesh.Faces.AddFace(m, l + 1, m + 1);
          }
          else if (i != x_count)
          {
            mesh.Faces.AddFace(k, k + 1, l);
            mesh.Faces.AddFace(l, k + 1, m + 1);
            mesh.Faces.AddFace(l, m, m + 1);
          }
        }
        else if(j % 4 == 2 && j + 1 != y_count && j != y_count)
        {
          if(i % 2 == 0 && i != x_count)
          {
            mesh.Faces.AddFace(k, k + 1, l);
            mesh.Faces.AddFace(l, k + 1, m + 1);
            mesh.Faces.AddFace(l, m, m + 1);
          }
          else if (i != x_count)
          {
            mesh.Faces.AddFace(k, l + 1, m);
            mesh.Faces.AddFace(k, k + 1, l + 1);
            mesh.Faces.AddFace(m, l + 1, m + 1);
          }
        }
        else if(j % 4 == 1 && j == y_count)
        {
          if(i % 2 == 0 && i != x_count)
          {
            mesh.Faces.AddFace(k, k + 1, k - x_count - 1);
            mesh.Faces.AddFace(k + 1, k - x_count - 1, k - x_count);
          }
          else if (i != x_count)
          {
            mesh.Faces.AddFace(k, k - x_count - 1, k - x_count);
            mesh.Faces.AddFace(k, k + 1, k - x_count);
          }
        }

        else if(j % 4 == 3 && j == y_count)
        {
          if(i % 2 == 0 && i != x_count)
          {
            mesh.Faces.AddFace(k, k - x_count - 1, k - x_count);
            mesh.Faces.AddFace(k, k + 1, k - x_count);
          }
          else if (i != x_count)
          {
            mesh.Faces.AddFace(k, k - x_count - 1, k + 1);
            mesh.Faces.AddFace(k + 1, k - x_count - 1, k - x_count);
          }
        }
      }
    }


    return mesh;
  }
# ---------- end c_script ----------

area = Area(Geometry=crv)  # -> Area, Centroid
c_script_2 = CSharpScript(
    Cuts=crv,
    CutCenter=area.Centroid,
    TriMesh=c_script.TriMesh,
    Xcount=c_script.Xcount,
    Ycount=c_script.Ycount,
    dx=number_slider,
    a=cos)  # -> out, HexBound, B; inputs Cuts: list of Curve, CutCenter: list of Point3d, TriMesh: Mesh, Xcount: Int32, Ycount: Int32, dx: Double, a: Double
# ---------- c_script_2: C# ----------
    // bounding hexagon
    List<Point3d> pts_bound = new List<Point3d> ();
    List<Box> box_bound = new List<Box> ();
    List<Point3d> hex_cens = new List<Point3d> ();
    List<Point3d> ver_and_cen = add_tricen(TriMesh);
    List<Point3d> vertices = new List<Point3d> ();
    List<Point3d> hex_bound = new List<Point3d>();
    List<Polyline> hexagon = new List<Polyline> ();
    List<Object> o_test = new List<Object>();
    int ver_coun = TriMesh.Vertices.Count - 1;
    Print(ver_coun.ToString());
    List<Point3d> pts_test = new List<Point3d>();
    double thres_ver = dx * Math.Sqrt(3) / 6;
    hexagon.Clear();
    
    for (int i = 0;i < TriMesh.Vertices.Count;i++)
    {
      double vx = TriMesh.Vertices[i].X;
      double vy = TriMesh.Vertices[i].Y;
      double vz = TriMesh.Vertices[i].Z;
      Point3d vert = new Point3d(vx,vy,vz);
      vertices.Add(vert);
    }


    for (int i = 0;i < Cuts.Count;i++)
    {
      double axis_x = 0;
      hex_bound.Clear();
      // find the center axis
      axis_x = find_axis_x(CutCenter[i], dx, TriMesh);

      // create bounding box
      Box box_b = new Box(Cuts[i].GetBoundingBox(true));
      box_bound.Add(box_b);
      Interval box_i = box_b.X;
      Point3f box_cen = new Point3f((float) box_b.Center.X, (float) box_b.Center.Y, (float) box_b.Center.Z);

      // find the hex center
      Point3d hex_cen = find_hex_cen(Cuts[i], dx, TriMesh, axis_x);
      hex_cens.Add(hex_cen);
      axis_x = hex_cen.X;

      // find vertical boundary point
      Point3d hex_vboun = find_hex_vboun(Cuts[i], axis_x, vertices, dx, hex_cen);

      // find the upper and bottom boundary point
      // need to calculate boundary condition

      Point3d hex_upboun;
      Point3d hex_btboun;
      find_up_and_bt_boun(Cuts[i], TriMesh, dx, hex_cen, out hex_upboun, out hex_btboun);

      // find the inclined
      Point3d hex_verup;
      Point3d hex_verbt;
      find_ver_up_and_bt(Cuts[i], vertices, dx, hex_vboun, hex_cen, hex_upboun, hex_btboun, out hex_verup, out hex_verbt);



      hex_bound.Add(hex_upboun);
      hex_bound.Add(hex_verup);
      hex_bound.Add(hex_verbt);
      hex_bound.Add(hex_btboun);
      Point3d hex_l1 = new Point3d(2 * hex_cen.X - hex_verbt.X, hex_verbt.Y, 0);
      Point3d hex_l2 = new Point3d(2 * hex_cen.X - hex_verup.X, hex_verup.Y, 0);
      hex_bound.Add(hex_l1);
      hex_bound.Add(hex_l2);

      Polyline hex_h = new Polyline(hex_bound);
      pts_test.Add(hex_upboun);
      hex_h.Add(hex_upboun);

      hexagon.Add(hex_h);
    }




    HexBound = hexagon;
    B = pts_test;
# ---------- c_script_2: C# additional code ----------
  public Box box_b;
  public Interval box_i;
  public Point3f box_cen;


  public List<Point3d> add_tricen(Mesh TriMesh)
  {
    List<Point3d> pts = new List<Point3d> ();
    for(int i = 0;i < TriMesh.Vertices.Count;i++)
    {
      pts.Add(TriMesh.Vertices[i]);
    }

    for(int i = 0;i < TriMesh.Faces.Count;i++)
    {
      pts.Add(TriMesh.Faces.GetFaceCenter(i));
    }


    return pts;
  }

  // find the axis_x
  public double find_axis_x(Point3d CutCenter, double dx, Mesh TriMesh)
  {
    Point3d pt_cen = CutCenter;
    double x_dist = pt_cen.X - TriMesh.Vertices[0].X;
    int count_axis = Convert.ToInt32((x_dist - x_dist % dx) / dx);
    double axis_x = count_axis * dx + TriMesh.Vertices[0].X;
    return axis_x;
  }

  //create bounding box
  public void find_bounding_box(Curve Cuts)
  {
    box_b = new Box(Cuts.GetBoundingBox(true));
    box_i = box_b.X;
    box_cen = new Point3f((float) box_b.Center.X, (float) box_b.Center.Y, (float) box_b.Center.Z);
  }



  public Point3d find_hex_cen (Curve Cuts, double dx, Mesh TriMesh, double axis_x)
  {
    find_bounding_box(Cuts);

    // find center of hexagon
    double dist_c = dx;
    Point3d hex_cen = TriMesh.Vertices[0];
    for(int j = 0;j < TriMesh.Vertices.Count;j++)
    {
      if(Math.Abs(TriMesh.Vertices[j].X - axis_x) < dx)
      {
        double dist_pts = TriMesh.Vertices[j].DistanceTo(box_cen);
        if(dist_pts < dist_c)
        {
          dist_c = dist_pts;
          hex_cen = TriMesh.Vertices[j];
        }
      }
    }
    return hex_cen;
  }

  public Point3d find_hex_vboun(Curve Cuts, double axis_x, List<Point3d> ver_and_cen, double dx, Point3d hex_cen)
  {
    // find vertical boundary point
    find_bounding_box(Cuts);

    Point3d hex_vboun = new Point3d(0, 0, 0);
    double x_br = box_cen.X + box_i.Length / 2;
    double x_bl = box_cen.X - box_i.Length / 2;
    double dist_r = Math.Abs(x_br - axis_x);
    double dist_l = Math.Abs(x_bl - axis_x);
    double x_b = 0;
    bool left = true;
    if(dist_r < dist_l)
    {
      x_b = x_bl;
    }
    else
    {
      x_b = x_br;
      left = false;
    }
    Print(left.ToString());
    double dist_b = dx;
    for(int j = 0;j < ver_and_cen.Count;j++)
    {
      if(Math.Abs(ver_and_cen[j].Y - hex_cen.Y) < dx)
      {
        if(left)
        {
          if(Math.Abs(ver_and_cen[j].X - x_b) < dist_b && x_b - ver_and_cen[j].X > 0)
          {
            dist_b = Math.Abs(ver_and_cen[j].X - x_b);
            hex_vboun = ver_and_cen[j];
          }
        }
        else if(Math.Abs(ver_and_cen[j].X - x_b) < dist_b && ver_and_cen[j].X - x_b > 0)
        {
          dist_b = Math.Abs(ver_and_cen[j].X - x_b);
          Print(dist_b.ToString());
          hex_vboun = ver_and_cen[j];
        }
      }
    }
    return hex_vboun;
  }

  public void find_up_and_bt_boun(Curve Cuts, Mesh TriMesh, double dx, Point3d hex_cen, out Point3d hex_upboun, out Point3d hex_btboun)
  {

    find_bounding_box(Cuts);
    double y_bu = box_cen.Y + box_b.Y.Length / 2;
    double y_bb = box_cen.Y - box_b.Y.Length / 2;
    hex_upboun = new Point3d(hex_cen.X, TriMesh.Vertices[0].Y, 0);
    int ver_coun = TriMesh.Vertices.Count - 1;
    hex_btboun = new Point3d(hex_cen.X, TriMesh.Vertices[ver_coun].Y, 0);
    double dist_bu = ver_coun * dx;
    double dist_bb = ver_coun * dx;
    // here use default equi triangle
    double thres_ver = dx * Math.Sqrt(3) / 6;
    for(int j = 0;j < TriMesh.Vertices.Count;j++)
    {
      if(Math.Abs(TriMesh.Vertices[j].X - hex_cen.X) < dx / 10)
      {

        if(TriMesh.Vertices[j].Y - y_bu > 0 && (TriMesh.Vertices[j].Y - y_bu < dist_bu))
        {
          dist_bu = TriMesh.Vertices[j].Y - y_bu;
          hex_upboun = TriMesh.Vertices[j];
        }


        if(y_bb - TriMesh.Vertices[j].Y > 0 && ( y_bb - TriMesh.Vertices[j].Y < dist_bb))
        {
          dist_bb = y_bb - TriMesh.Vertices[j].Y;
          hex_btboun = TriMesh.Vertices[j];
        }
      }
    }
  }

  public void find_ver_up_and_bt(Curve Cuts, List<Point3d> ver_and_cen, double dx, Point3d hex_vboun, Point3d hex_cen, Point3d hex_upboun, Point3d hex_btboun, out Point3d hex_verup, out Point3d hex_verbt)
  {
    find_bounding_box(Cuts);
    hex_verup = new Point3d(hex_vboun.X, hex_upboun.Y, 0);
    hex_verbt = new Point3d(hex_vboun.X, hex_btboun.Y, 0);
    double dist_y2 = 0;
    double dist_y1 = 0;
    for(int j = 0;j < ver_and_cen.Count;j++)
    {
      if(Math.Abs(ver_and_cen[j].X - hex_vboun.X) < dx / 10)
      {
        // find the upper vertical bound
        if(ver_and_cen[j].Y < hex_upboun.Y && ver_and_cen[j].Y > box_cen.Y)
        {
          Point3d up1 = ver_and_cen[j];
          Point3d up1_mr = new Point3d(2 * hex_cen.X - up1.X, up1.Y, 0);
          Line l_up1 = new Line(up1, hex_upboun);
          Line l_up2 = new Line(up1_mr, hex_upboun);
          var inters_up1 = Rhino.Geometry.Intersect.Intersection.CurveLine(Cuts, l_up1, 0.001, 0.0);
          var inters_up2 = Rhino.Geometry.Intersect.Intersection.CurveLine(Cuts, l_up2, 0.001, 0.0);

          if(inters_up1.Count < 2 && inters_up2.Count < 2)
          {
            double dist = hex_upboun.Y - up1.Y;
            if(dist > dist_y1)
            {
              dist_y1 = dist;
              hex_verup = up1;
            }
          }
        }
        // find the bottom vertical bound
        if(ver_and_cen[j].Y > hex_btboun.Y && ver_and_cen[j].Y < box_cen.Y)
        {
          Point3d bt1 = ver_and_cen[j];
          Point3d bt1_mr = new Point3d(2 * hex_cen.X - bt1.X, bt1.Y, 0);
          Line l_bt1 = new Line(hex_btboun, bt1);
          Line l_bt2 = new Line(hex_btboun, bt1_mr);
          var inters_bt1 = Rhino.Geometry.Intersect.Intersection.CurveLine(Cuts, l_bt1, 0.001, 0.0);
          var inters_bt2 = Rhino.Geometry.Intersect.Intersection.CurveLine(Cuts, l_bt2, 0.001, 0.0);
          double dist = bt1.Y - hex_btboun.Y;

          if(dist > dist_y2 && inters_bt1.Count < 2 && inters_bt2.Count < 2)
          {
            dist_y2 = dist;
            hex_verbt = bt1;
          }
        }
      }
    }
  }
# ---------- end c_script_2 ----------

points = PointList(Points=c_script.Pts, Size=Slider(0.5, range=0..1))
bbox = BoundingBox(Content=c_script.TriMesh, Plane=PlaneXY(0, 0, 0))  # -> Box, Box_2
debrep = DeconstructBrep(Brep=bbox.Box)  # -> Faces, Edges, Vertices
# New Boundary
crv_3 = Curve(debrep.Edges)
# Hexagon
pt = Point(c_script_2.B)
crv_4 = Curve(c_script_2.HexBound)
area_2 = Area(Geometry=crv)  # -> Area, Centroid
area_3 = Area(Geometry=crv_4)  # -> Area, Centroid
area_4 = Area(Geometry=crv_2)  # -> Area, Centroid
join = JoinCurves(Curves=crv_3, Preserve=False)
# Split Mesh
cluster = Cluster(M_2=c_script.TriMesh, trimesh=c_script.TriMesh, hexbound=c_script_2.HexBound, M=c_script.TriMesh, C=c_script_2.HexBound)  # -> r0, r1
area_5 = Area(Geometry=join)  # -> Area, Centroid
ma = MassAddition(Input=area_2.Area)  # -> Result, PartialResults
ma_2 = MassAddition(Input=area_3.Area)  # -> Result, PartialResults
mesh = Mesh(cluster.r0)
mesh_2 = Mesh(cluster.r1)
subtraction = Subtraction(A=area_4.Area, B=area_5.Area)
subtraction_2 = Subtraction(A=area_4.Area, B=ma.Result)
subtraction_3 = Subtraction(A=ma_2.Result, B=ma.Result)
# Select Boundary Mesh
cluster_2 = Cluster_3(E=crv_4, M=mesh, B=crv_4)  # -> relay, P, mesh_2
expression = Expression(L1=subtraction_3, L2=subtraction, Total=subtraction_2, Expression="1-(L1+L2)/Total")
# Merge faces
cluster_3 = Cluster_2(relay=number_slider, M=cluster_2.mesh_2, G=cluster_2.P)
# Recycle Efficiency
panel = Panel(expression)
# Assign Crease Pattern
cluster_4 = Cluster_4(relay_2=crv_3, C=crv_4, C_2=crv, M=cluster_3, relay=cluster_2.relay, M_2=mesh_2)  # -> relay_3, L, mountain, valley

# ----
# Valley
# Assign Crease Pattern
panel_2 = Panel("blue")
crv_5 = Curve(cluster_4.valley)
preview = CustomPreview(Geometry=crv_5, Material=panel_2)

crv_6 = Curve(cluster_4.mountain)
# Mountain
panel_3 = Panel("red")
preview_2 = CustomPreview(Geometry=crv_6, Material=panel_3)

# ----
# Cut Lines
line = Line([crv_3, cluster_4.relay_3, cluster_4.L])

preview_3 = CustomPreview(
    Geometry=line,
    Material={diffuse=RGB(221, 160, 221), emission=RGB(66, 48, 66), shine=0.5, specular=RGB(255, 255, 255), transparency=0})

# ==== cluster Cluster
M = ClusterInput()
demesh = DeconstructMesh(Mesh=M)  # -> Vertices, Faces, Colours, Normals
C = ClusterInput()
incurves = PointInCurves(Point=demesh.Vertices, Curves=C)  # -> Relationship, Index, Point
mindex = MemberIndex(Set=demesh.Vertices, Member=demesh.Vertices)  # -> flatten(Index), Count
equals = Equality(FirstNumber=incurves.Relationship, SecondNumber=Slider(2, range=0..10))  # -> Equality, Inequality
equals_2 = Equality(FirstNumber=incurves.Relationship, SecondNumber=Slider(1, range=0..1))  # -> Equality, Inequality
dispatch = Dispatch(List=mindex.Index, DispatchPattern=equals.Equality)  # -> ListA, ListB
dispatch_2 = Dispatch(List=mindex.Index, DispatchPattern=equals_2.Equality)  # -> ListA, ListB
trimesh = ClusterInput()
hexbound = ClusterInput()
merge = Merge(Data1=dispatch.ListA, Data2=dispatch_2.ListA)
c_script = CSharpScript(TriMesh=trimesh, HexBound=hexbound, PtsInside=merge)  # -> out, A; inputs TriMesh: Mesh, HexBound: list of Polyline, PtsInside: list of Int32
# ---------- c_script: C# ----------
    List<int> Face_r = new List<int>();



    for(int i = 0;i < HexBound.Count;i++)
    {
      for(int j = 0;j < TriMesh.Faces.Count;j++)
      {

        int a1 = TriMesh.Faces[j][0];
        int a2 = TriMesh.Faces[j][1];
        int a3 = TriMesh.Faces[j][2];

        if( PtsInside.Contains(a1)||PtsInside.Contains(a2)||PtsInside.Contains(a3))
        {
          Face_r.Add(j);
        }
      }
    }


    A = Face_r;
# ---------- end c_script ----------
M_2 = ClusterInput()
item = ListItem(List=demesh.Vertices, Index=merge, Wrap=True)
wbreroute = WeaverbirdsRerouteFaces(Mesh=M_2, Index=c_script.A)  # -> Mesh0, Mesh1
r0 = ClusterOutput(wbreroute.Mesh0)
r1 = ClusterOutput(wbreroute.Mesh1)
mesh = Mesh(wbreroute.Mesh1)

# ==== cluster Cluster_2
relay = ClusterInput()
G = ClusterInput()
area = Area(Geometry=G)  # -> Area, Centroid
sort = SortList(Keys=area.Area)  # -> Keys, ValuesA
M = ClusterInput()
item = ListItem(List=sort.Keys, Index="-1", Wrap=True)
division = Division(A=relay, B=Slider(5, range=0..10))
subtraction = Subtraction(A=area.Area, B=item)
smaller = SmallerThan(FirstNumber=subtraction, SecondNumber="-0.01")  # -> SmallerThan, OrEqualTo
wbreroutepattern = WeaverbirdsRerouteFacesByPattern(Mesh=M, Index=smaller.SmallerThan)  # -> Mesh0ContainingTrueValues, Mesh1ContainingFalseValues
faceb = FaceBoundaries(Mesh=wbreroutepattern.Mesh1ContainingFalseValues)
area_2 = Area(Geometry=faceb)  # -> Area, Centroid
alignvert = AlignVertices(Mesh=wbreroutepattern.Mesh0ContainingTrueValues, Tolerance=division)  # -> Result, Count
larger = LargerThan(FirstNumber=area_2.Area, SecondNumber="0")  # -> LargerThan, OrEqualTo
wbreroutepattern_2 = WeaverbirdsRerouteFacesByPattern(Mesh=wbreroutepattern.Mesh1ContainingFalseValues, Index=larger.LargerThan)  # -> Mesh0ContainingTrueValues, Mesh1ContainingFalseValues
mesh = Mesh(wbreroutepattern_2.Mesh0ContainingTrueValues)
mjoin = MeshJoin(Meshes=[mesh, alignvert.Result])
faceb_2 = FaceBoundaries(Mesh=mjoin)
M_2 = ClusterOutput(mjoin)

# ==== cluster Cluster_3
E = ClusterInput()
boundary = BoundarySurfaces(Edges=E)
Z = UnitZ(Factor=1)
B = ClusterInput()
area = Area(Geometry=boundary)  # -> Area, Centroid
relay = ClusterOutput(boundary)
extr = Extrude(Base=B, Direction=Z)
M = ClusterInput()
Z_2 = UnitZ(Factor=Slider(-0.5, range=-1..0))
move = Move(Geometry=extr, Motion=Z_2)  # -> Geometry, Transform
disjoint = DisjointMesh(Mesh=M)
panel = Panel(area.Area)
msplit = MeshSplit(Mesh=flatten(disjoint), Splitters=flatten(move.Geometry))
area_2 = MeshArea(Mesh=msplit)  # -> Area, Centroid
c_script = CSharpScript(Mesh_Split=flatten(msplit), Boundary=E)  # -> out, A; inputs Mesh_Split: list of Mesh, Boundary: list of Curve
# ---------- c_script: C# ----------
    List<Mesh> MeshBoundary = new List<Mesh> ();

    for(int i = 0;i < Mesh_Split.Count;i++)
    {
      bool add_mesh = false;
      bool find_mesh = true;
      for(int j = 0; j < Boundary.Count;j++)
      {
        double area_b = Rhino.Geometry.AreaMassProperties.Compute(Boundary[j]).Area;
        double area_m = Rhino.Geometry.AreaMassProperties.Compute(Mesh_Split[i]).Area;
        Print((area_b - area_m).ToString());

        if(Math.Abs(area_b - area_m) > 0.01)
        {
          add_mesh = true;
        }
        else
        {
          add_mesh = false;
          find_mesh = false;
        }
      }
      if(add_mesh && find_mesh)
      {
        MeshBoundary.Add(Mesh_Split[i]);
      }

    }

    A = MeshBoundary;
# ---------- end c_script ----------
item = ListItem(List=flatten(msplit), Index=Slider(2, range=0..4), Wrap=True)
panel_2 = Panel(area_2.Area)
panel_3 = Panel(c_script.out)
mesh = Mesh(c_script.A)
wbfacepolys = WeaverbirdsFacePolylines(Mesh=mesh)
mesh_2 = ClusterOutput(mesh)
faceb = FaceBoundaries(Mesh=mesh)
P = ClusterOutput(wbfacepolys)

# ==== cluster Cluster_4
C = ClusterInput()
M = ClusterInput()
cp = ControlPoints(Curve=C)  # -> Points, Weights, Knots
C_2 = ClusterInput()
faceb = FaceBoundaries(Mesh=M)
crv_cp = CurveClosestPoint(Point=cp.Points, Curve=graft(C_2))  # -> Point, Parameter, Distance
M_2 = ClusterInput()
ln = Line(StartPoint=cp.Points, EndPoint=crv_cp.Point)
faceb_2 = FaceBoundaries(Mesh=M_2)
L = ClusterOutput(ln)
explode = Explode(Curve=faceb_2, Recursive=True)  # -> Segments, Vertices
relay = ClusterInput()
end = EndPoints(Curve=explode.Segments)  # -> Start, End
vec2pt = Vector2Pt(PointA=end.Start, PointB=end.End, Unitize=False)  # -> Vector, Length
X = UnitX(Factor=1)
explode_2 = Explode(Curve=faceb, Recursive=True)  # -> Segments, Vertices
multiplication = Multiplication(A=vec2pt.Vector, B=X)
midpt = CurveMiddle(Curve=flatten(explode_2.Segments))
equals = Equality(FirstNumber=multiplication, SecondNumber="0")  # -> Equality, Inequality
cullpt = CullDuplicates(Points=midpt, Tolerance=0.1, CullMode=1)  # -> Points, Indices, Valence
dispatch = Dispatch(List=explode.Segments, DispatchPattern=equals.Equality)  # -> ListA, ListB
item = ListItem(List=flatten(explode_2.Segments), Index=cullpt.Indices, Wrap=True)
explode_3 = Explode(Curve=item, Recursive=True)  # -> Segments, Vertices
end_2 = EndPoints(Curve=dispatch.ListB)  # -> Start, End
relay_2 = ClusterInput()
vec2pt_2 = Vector2Pt(PointA=end_2.Start, PointB=end_2.End, Unitize=False)  # -> Vector, Length
Y = UnitY(Factor=1)
end_3 = EndPoints(Curve=explode_3.Segments)  # -> Start, End
X_2 = UnitX(Factor=1)
vec2pt_3 = Vector2Pt(PointA=end_3.Start, PointB=end_3.End, Unitize=False)  # -> Vector, Length
multiplication_2 = Multiplication(A=vec2pt_2.Vector, B=Y)
relay_3 = ClusterOutput(relay_2)
equals_2 = Equality(FirstNumber=multiplication_2, SecondNumber="0")  # -> Equality, Inequality
Y_2 = UnitY(Factor=1)
Z = UnitZ(Factor=1)
boundary = BoundarySurfaces(Edges=relay_2)
dispatch_2 = Dispatch(List=dispatch.ListB, DispatchPattern=equals_2.Equality)  # -> ListA, ListB
multiplication_3 = Multiplication(A=flatten(vec2pt_3.Vector), B=Y_2)
equals_3 = Equality(FirstNumber=multiplication_3, SecondNumber="0")  # -> Equality, Inequality
extr = Extrude(Base=boundary, Direction=Z)
crv = Curve(dispatch_2.ListB)
dispatch_3 = Dispatch(List=flatten(explode_3.Segments), DispatchPattern=equals_3.Equality)  # -> ListA, ListB
end_4 = EndPoints(Curve=dispatch_3.ListB)  # -> Start, End
vec2pt_4 = Vector2Pt(PointA=end_4.Start, PointB=end_4.End, Unitize=False)  # -> Vector, Length
multiplication_4 = Multiplication(A=flatten(vec2pt_4.Vector), B=X_2)
equals_4 = Equality(FirstNumber=multiplication_4, SecondNumber="0")  # -> Equality, Inequality
crv_2 = Curve([dispatch.ListA, dispatch_2.ListA])
Z_2 = UnitZ(Factor=-0.5)
dispatch_4 = Dispatch(List=dispatch_3.ListB, DispatchPattern=equals_4.Equality)  # -> ListA, ListB
move = Move(Geometry=extr, Motion=Z_2)  # -> Geometry, Transform
crv_3 = Curve(dispatch_4.ListB)
crv_4 = Curve([dispatch_3.ListA, dispatch_4.ListA])
crv_5 = Curve([crv_3, crv])
trim = TrimWithBrep(Curve=crv_5, Brep=move.Geometry)  # -> Inside, Outside
crv_6 = Curve([relay, crv_4, crv_2])
trim_2 = TrimWithBrep(Curve=crv_6, Brep=move.Geometry)  # -> Inside, Outside
# Valley
valley = ClusterOutput(trim.Inside)
item_2 = ListItem(List=crv_4, Index=Slider(26, range=0..56), Wrap=True)
# Mountain
mountain = ClusterOutput(trim_2.Inside)
